# Grasshopper definition sample.gh (Grasshopper 1.0.7)
# plug-ins: RugOscGH

oscsender = OscSender(
    Send=Toggle(False),
    LocalIPAddress="127.0.0.1",
    LocalPort=10000,
    RemoteIPAddress="127.0.0.1",
    RemotePort=12345,
    Data=Slider(6.26, range=0..10),
    Tag="data",
    PacketSize=2048,
    BufferSize=600)
oscreceiver = OscReceiver(Receive=Toggle(False), KeepLastData=Toggle(True), IPAddress="127.0.0.1", Port=12345, PacketSize=2048, BufferSize=600)
panel = Panel(oscreceiver)
